# Grasshopper definition EX_I-2_solution.gh (Grasshopper 1.0.7)

# ---- group: Library of movements
number_slider = Slider(10, range=1..10)
number_slider_2 = Slider(3, range=1..10)
negative = Negative(Value=number_slider)
unit_y = UnitY(Factor=number_slider_2)
unit_x = UnitX(Factor=number_slider)
unit_y_2 = UnitY(Factor=number_slider_2)
unit_x_2 = UnitX(Factor=number_slider)
unit_y_3 = UnitY(Factor=number_slider_2)
unit_x_3 = UnitX(Factor=negative)
addition = Addition(A=unit_x_2, B=unit_y_2)
addition_2 = Addition(A=unit_x_3, B=unit_y_3)
negative_2 = Negative(Value=addition)
negative_3 = Negative(Value=unit_x)
negative_4 = Negative(Value=unit_y)
negative_5 = Negative(Value=addition_2)
vector = Vector(unit_x)
vector_2 = Vector(unit_y)
vector_3 = Vector(addition)
vector_4 = Vector(negative_3)
vector_5 = Vector(negative_4)
vector_6 = Vector(negative_2)
vector_7 = Vector(addition_2)
vector_8 = Vector(negative_5)

# ---- group: character main point
construct_point = ConstructPoint(XCoordinate=Slider(0, range=0..10), YCoordinate=Slider(0, range=0..10), ZCoordinate=Slider(0, range=0..10))
unit_x_4 = UnitX(Factor=Slider(20, range=1..20))
point = Point(construct_point)
move = Move(Geometry=point, Motion=unit_x)  # -> Geometry, Transform
move_2 = Move(Geometry=point, Motion=unit_x_4)  # -> Geometry, Transform
move_3 = Move(Geometry=move_2.Geometry, Motion=unit_x_4)  # -> Geometry, Transform

# ---- group: C
move_4 = Move(Geometry=move.Geometry, Motion=vector_7)  # -> Geometry, Transform
move_5 = Move(Geometry=move_4.Geometry, Motion=vector_2)  # -> Geometry, Transform
move_6 = Move(Geometry=move_5.Geometry, Motion=vector_3)  # -> Geometry, Transform
merge = Merge(Data1=move.Geometry, Data2=move_4.Geometry, Data3=move_5.Geometry, Data4=move_6.Geometry)
interpolate = Interpolate(Vertices=merge, Degree=3, Periodic=False, KnotStyle=1)  # -> Curve, Length, Domain

# ---- group: S
move_7 = Move(Geometry=move_2.Geometry, Motion=vector_3)  # -> Geometry, Transform
move_8 = Move(Geometry=move_7.Geometry, Motion=vector_7)  # -> Geometry, Transform
move_9 = Move(Geometry=move_8.Geometry, Motion=vector_3)  # -> Geometry, Transform
merge_2 = Merge(Data1=move_2.Geometry, Data2=move_7.Geometry, Data3=move_8.Geometry, Data4=move_9.Geometry)
interpolate_2 = Interpolate(Vertices=merge_2, Degree=3, Periodic=False, KnotStyle=1)  # -> Curve, Length, Domain

# ---- group: D
move_10 = Move(Geometry=move_3.Geometry, Motion=vector_3)  # -> Geometry, Transform
move_11 = Move(Geometry=move_10.Geometry, Motion=vector_2)  # -> Geometry, Transform
move_12 = Move(Geometry=move_11.Geometry, Motion=vector_7)  # -> Geometry, Transform
merge_3 = Merge(Data1=move_3.Geometry, Data2=move_10.Geometry, Data3=move_11.Geometry, Data4=move_12.Geometry)
interpolate_3 = Interpolate(Vertices=merge_3, Degree=3, Periodic=False, KnotStyle=1)  # -> Curve, Length, Domain
line = Line(StartPoint=move_3.Geometry, EndPoint=move_12.Geometry)
join_curves = JoinCurves(Curves=[interpolate_3.Curve, line], Preserve=False)  # -> flatten(Curves)

# ---- group: I
move_13 = Move(Geometry=line, Motion=unit_x_4)  # -> Geometry, Transform

# ---- group: pipes
pipe = Pipe(
    Curve=[interpolate.Curve, interpolate_2.Curve, join_curves, move_13.Geometry],
    Radius=Slider(1.565, range=0..10),
    Caps="2")  # -> flatten(Pipe)

# ---- group: rotate and scale
rotate = Rotate(Geometry=pipe, Angle=degrees(Slider(0, range=0..360)), Plane=point)  # -> Geometry, Transform
scale = Scale(Geometry=rotate.Geometry, Center=point, Factor=Slider(1, range=1..10))  # -> Geometry, Transform

# ----
panel = Panel("""True
True
True

False""")

# ---- group: color
boolean = Boolean(panel)
weave = Weave(
    Pattern=graft(boolean),
    Stream0=ColourSwatch(SwatchColor=RGB(0, 0, 255)),
    Stream1=ColourSwatch(SwatchColor=RGB(255, 0, 0)),
    NullGaps=False)  # -> flatten(Weave)
custom_preview = CustomPreview(Geometry=scale.Geometry, Material=weave)
